# Grasshopper definition AcousticMeshStudyColors-Final.gh (Grasshopper 1.0.6)

panel = Panel("ADDITIONAL CONTEXT GEOMETRY")
# (THIS SHOULD HAVE NO HOLES THAT MAY ALLOW PARTICLES TO ESCAPE
panel_2 = Panel("REQUIRED CONTEXT GEOMETRY")
panel_3 = Panel("SOUND SOURCE POINT")
panel_4 = Panel("(OPTIONAL)")
# THIS GEOMETRY CAN BE ASSIGNED A DIFFERENT NRC (NOISE REDUCTION VALUE)
panel_5 = Panel("(OPTIONAL)")

# ---- group: NRC
number_slider = Slider(0.6, range=0..1)

# ----
pt = Point(<point referenced from the Rhino model>)

# ---- group: Horizontal Cutting Plane
# ROUGHLY AT EAR HEIGHT
mesh = Mesh(<mesh referenced from the Rhino model>)

# ---- group: NEW GEOMERTY
geo = Geometry([<brep referenced from the Rhino model> x3])

# ---- group: ADDITIONAL GEOMETRY
geo_2 = Geometry([<brep referenced from the Rhino model> x6])

# ---- group: EXISITING CONTEXT
geo_3 = Geometry([<mesh referenced from the Rhino model> x17])

# ---- group: GEOMETRY PREP
number_slider_2 = Slider(700, range=0..1000)
panel_6 = Panel("12")

# ---- group: GEOMETRY PREP / Create sound vectors
pt_2 = ConstructPoint(XCoordinate=0, YCoordinate=0, ZCoordinate=0)
mesh_2 = Mesh(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)
vec2pt = Vector2Pt(PointA=pt_2, PointB=pt, Unitize=False)  # -> Vector, Length
move = Move(Geometry=mesh_2, Motion=vec2pt.Vector)  # -> Geometry, Transform
demesh = DeconstructMesh(Mesh=move.Geometry)  # -> Vertices, Faces, Colours, Normals
vec2pt_2 = Vector2Pt(PointA=pt, PointB=demesh.Vertices, Unitize=False)  # -> Vector, Length

# ---- group: GEOMETRY PREP
# CONNECT IF YOU WANT TO SEE THE DIFFERENCE BETWEEN EXISTING FABLAB AND FABLAB w/ NEW GEO
pt_3 = Point(pt)
mesh_3 = Mesh(geo_3)
mesh_4 = Mesh(geo_2)
mesh_5 = Mesh(geo)
data = Data(pt_3)
geo_4 = Merge03(StreamA=geo_3, StreamB=mesh_4, StreamC=mesh_5)
unit = UnitVector(Vector=vec2pt_2.Vector)

# ----
panel_7 = Panel("NOW IT'S CONNECTED")

# ---- group: RAYTRACING ENGINE
forwardraytracing = Ladybug_ForwardRaytracing(startPts=graft(data), startVectors=unit, context=flatten(geo_4), numOfBounce=panel_6, lastBounceLen=number_slider_2)  # -> simplify(rays); plug-in component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

# ---- group: Clean lines
number_slider_3 = Slider(600, range=0..1000)
number_slider_4 = Slider(3, range=0..10)

data_2 = Data(forwardraytracing)
disc = Discontinuity(Curve=data_2, Level=1)  # -> Points, simplify(Parameters)
graft = GraftTree(Tree=data_2, IncludeEmptyLists=True, IncludeNullItems=True)  # -> simplify(Tree)
shatter = Shatter(Curve=graft, Parameters=disc.Parameters)  # -> simplify(Segments)
cull_i = CullIndex(List=shatter, Indices="-1", Wrap=True)
join = JoinCurves(Curves=cull_i, Preserve=False)  # -> flatten(Curves)
data_3 = Data(join)
reb = RebuildCurve(Curve=data_3, Degree=number_slider_4, Count=number_slider_3, Tangents=False)  # -> reparameterize(Curve)

# ---- group: CALCULATE NOISE REDUCTION COEFFIEINTS
deface = DeconstructFace(Face=demesh.Faces)  # -> simplify(graft(CornerA)), simplify(graft(CornerB)), simplify(graft(CornerC)), CornerD
merge = Merge(Data1=deface.CornerA, Data2=deface.CornerB, Data3=deface.CornerC)
item = ListItem(List=data_3, Index=merge, Wrap=True)  # -> simplify(Item)
disc_2 = Discontinuity(Curve=item, Level=1)  # -> Points, Parameters
merge_2 = Merge(Data1=mesh_3, Data2=mesh_4)
shatter_2 = Shatter(Curve=graft(item), Parameters=disc_2.Parameters)
len = Length(Curve=shatter_2)
mjoin = MeshJoin(Meshes=merge_2)
meshcp = MeshClosestPoint(Point=disc_2.Points, Mesh=mjoin)  # -> Point, Index, Parameter
dist = Distance(PointA=disc_2.Points, PointB=meshcp.Point)
int = Integer(dist)
larger = LargerThan(FirstNumber=int, SecondNumber=Slider(1, range=0..1))  # -> LargerThan, OrEqualTo
dispatch = Dispatch(List=int, DispatchPattern=larger.OrEqualTo)  # -> ListA, ListB
trim = TrimTree(Tree=dispatch.ListB, Depth=1)
number_slider_5 = Slider(0.9, range=0..1)
number_slider_6 = Slider(0.05, range=0..0.1)
division = Division(A=dispatch.ListA, B=dispatch.ListA)
lng = ListLength(List=trim)
repeat = RepeatData(Data="0.95", Length=lng)  # -> simplify(Data)
subtraction = Subtraction(A=division, B=number_slider)
weave = Weave(Pattern=larger.OrEqualTo, Stream0=repeat, Stream1=subtraction, NullGaps=False)
cull_i_2 = CullIndex(List=weave, Indices="0", Wrap=True)
replace = ReplaceItems(List=cull_i_2, Item=Slider(1, range=0..1), Indices="0", Wrap=False)  # -> simplify(List)

# ----
item_2 = ListItem(List=reb, Index=merge, Wrap=True)  # -> simplify(Item)
data_4 = Data(item_2)
len_2 = Length(Curve=data_4)

# ----
# CHANGE THIS VALUE BASED ON YOUR COMPUTER'S RAM
# SHOULD BE NO MORE THAN 2x YOUR TOTAL RAM
# IT PROBABLY WONT CRASH... JUST SORT OF DO NOTHING AT 100% RAM USAGE UNTIL YOU KILL IT
# CHECK YOUR RAM IF SOMETHING SEEMS WRONG... IF IT GETS TO 100% and STAYS THERE IT IS PROBABLY OUT OF MEMORY AND JUST NOT GIVING UP
number_slider_7 = Slider(40, range=0..100)

# ---- group: CALCULATE NOISE REDUCTION COEFFIEINTS / Travel Distances
data_5 = Data(simplify(len))

# ---- group: CALCULATE NOISE REDUCTION COEFFIEINTS / Multipliers
data_6 = Data(replace)

# ---- group: CREATE SOUND WAVES
multiplication = Multiplication(A=number_slider_7, B="3")
series = Series(Start="1", Step=1, Count=number_slider_7)
graft_2 = GraftTree(Tree=series, IncludeEmptyLists=True, IncludeNullItems=True)
division_2 = Division(A=graft(graft_2), B=flatten(len_2))  # -> simplify(Result)
partition = PartitionList(List=division_2, Size="3")
repeat_2 = RepeatData(Data=data_4, Length=graft(multiplication))  # -> simplify(Data)
path_mapper = PathMapper(partition, source="{A;B}(i)", target="{B;i}(A)")
data_7 = Data(path_mapper)
partition_2 = PartitionList(List=repeat_2, Size="3")
path_mapper_2 = PathMapper(partition_2, source="{A;B}(i)", target="{A;i}(B)")
multiplication_2 = Multiplication(A=data_7, B="25")
larger_2 = LargerThan(FirstNumber=multiplication_2, SecondNumber="1")  # -> LargerThan, OrEqualTo
dispatch_2 = Dispatch(List=multiplication_2, DispatchPattern=larger_2.OrEqualTo)  # -> ListA, ListB
division_3 = Division(A=dispatch_2.ListA, B=dispatch_2.ListA)
weave_2 = Weave(Pattern=larger_2.OrEqualTo, Stream0=dispatch_2.ListB, Stream1=division_3, NullGaps=False)
eval = EvaluateCurve(Curve=reparameterize(path_mapper_2), Parameter=weave_2)  # -> Point, Tangent, Angle
path_mapper_3 = PathMapper(eval.Point, source="{A;B}(i)", target="{i;A}(B)")
item_3 = ListItem(List=data_3, Index=merge, Wrap=True)  # -> simplify(Item)
data_8 = Data(path_mapper_3)
multiplication_3 = Multiplication(A=number_slider_7, B="3")
repeat_3 = RepeatData(Data=item_3, Length=multiplication_3)
triangle = MeshTriangle(CornerA=0, CornerB=1, CornerC=2)
partition_3 = PartitionList(List=repeat_3, Size="3")  # -> simplify(Chunks)
conmesh = ConstructMesh(Vertices=data_8, Faces=simplify(graft(triangle)))
path_mapper_4 = PathMapper(partition_3, source="{A;B}(i)", target="{B;A}(i)")
trim_2 = TrimTree(Tree=conmesh, Depth=1)
data_9 = Data(path_mapper_4)
crv_cp = CurveClosestPoint(Point=data_8, Curve=data_9)  # -> Point, Parameter, Distance

# ---- group: CALCULATE DECIBEL (ABSTRACTION) / Same as Num Bounces
number_slider_8 = Slider(12, range=0..100)

# ---- group: CALCULATE DECIBEL (ABSTRACTION)
number_slider_9 = Slider(36, range=0..100)
number_slider_10 = Slider(12, range=0..100)

# ---- group: CALCULATE DECIBEL (ABSTRACTION) / Steps to cycle through
series_2 = Series(Start=0, Step=1, Count=number_slider_8)

# ---- group: CREATE ANALYSIS GRID
demesh_2 = DeconstructMesh(Mesh=mesh)  # -> Vertices, Faces, Colours, Normals
item_4 = ListItem(List=demesh_2.Vertices, Index=0, Wrap=True)  # -> Item, Item1, Item2, Item3
xy = XYPlane(Origin=item_4.Item)
srf4pt = _4PointSurface(CornerA=item_4.Item, CornerB=item_4.Item1, CornerC=item_4.Item2, CornerD=item_4.Item3)
debrep = DeconstructBrep(Brep=srf4pt)  # -> Faces, Edges, Vertices
item_5 = ListItem(List=debrep.Edges, Index=0, Wrap=True)  # -> Item, Item1
number_slider_11 = Slider(24, range=0..100)
len_3 = Length(Curve=item_5.Item)
len_4 = Length(Curve=item_5.Item1)
division_4 = Division(A=len_3, B=number_slider_11)
division_5 = Division(A=len_4, B=number_slider_11)
divide = DivideDomain²(Domain=srf4pt, UCount=division_4, VCount=division_5)
subsrf = Isotrim(Surface=srf4pt, Domain=divide)
area = Area(Geometry=subsrf)  # -> Area, flatten(Centroid)
scale = Scale(Geometry=subsrf, Center=area.Centroid, Factor=Slider(0.98, range=0..1))  # -> Geometry, Transform
bbox = BoundingBox(Content=scale.Geometry, Plane=PlaneXY(0, 0, 0))  # -> Box, Box_2

# ----
number_slider_12 = Slider(18, range=0..39)

# ---- group: CALCULATE DECIBEL (ABSTRACTION)
# MULTIPLIER SHOULD BE APPLIED TO THE dB, NOT THE DIST
# Take each dB val and multiply it by the multiplier
# but first aggregate the multiplier
number_slider_13 = Slider(13, range=0..100)
ma = MassAddition(Input=data_5)  # -> Result, PartialResults
panel_8 = Panel(ma.PartialResults)
number_slider_14 = Slider(1, range=0..1)
python = PythonScript(A=replace, N=series_2)  # -> out, a; inputs A: list, N: Int32
# ---------- python: Python ----------
import rhinoscriptsyntax as rs

val = 1
i = 0
while (i < N):
    val = val * A[i]
    i+=1

a = val
# ---------- end python ----------
shift = ShiftList(List=python.a, Shift=1, Wrap=True)
partition_4 = PartitionList(List=flatten(shift), Size=number_slider_9)  # -> simplify(Chunks)
partition_5 = PartitionList(List=partition_4, Size=number_slider_10)  # -> simplify(Chunks)
cull_i_3 = CullIndex(List=shift, Indices="-1", Wrap=True)
panel_9 = Panel(replace)
number_slider_15 = Slider(5, range=0..10)
panel_11 = Panel(cull_i_3)
multiplication_4 = Multiplication(A="12", B=number_slider_7)
round = Round(Number=crv_cp.Parameter)  # -> Nearest, Floor, Ceiling

# ---- group: CALCULATE DECIBEL (ABSTRACTION) / Non-Zero
addition = Addition(A=ma.PartialResults, B=number_slider_14)

# ---- group: CALCULATE DECIBEL (ABSTRACTION) / dB
python_2 = PythonScript(x=addition)  # -> out, a
# ---------- python_2: Python ----------
import math
a = (60-abs(20*math.log10(36.0/x)))
# ---------- end python_2 ----------

# ---- group: CALCULATE DECIBEL (ABSTRACTION) (continued)
multiplication_5 = Multiplication(A=python_2.a, B=partition_5)
replace_2 = ReplaceItems(List=multiplication_5, Item="1", Indices=Slider(11, range=0..100), Wrap=False)  # -> simplify(List)
panel_12 = Panel(replace_2)
path_mapper_5 = PathMapper(replace_2, source="{A;B}(i)", target="{A;i}(B)")
ma_2 = MassAddition(Input=path_mapper_5)  # -> Result, PartialResults
division_6 = Division(A=ma_2.Result, B="3")
trim_3 = TrimTree(Tree=division_6, Depth=1)
panel_13 = Panel(trim_3)
repeat_4 = RepeatData(Data=trim_3, Length=multiplication_4)
partition_6 = PartitionList(List=repeat_4, Size="12")  # -> simplify(Chunks)
path_mapper_6 = PathMapper(partition_6, source="{A;B}(i)", target="{B;A}(i)")
data_10 = Data(path_mapper_6)
item_6 = ListItem(List=data_10, Index=round.Floor, Wrap=True)
ma_3 = MassAddition(Input=item_6)  # -> Result, PartialResults
division_7 = Division(A=ma_3.Result, B="3")

# ---- group: ALL RECORDED DATA
panel_14 = Panel("62 frames || 5120 meshes || 384 grids")
mmx = MeshMesh(MeshA=trim_2, MeshB=mesh, UseMeshMeshFast=True)
lng_2 = ListLength(List=mmx)
panel_15 = Panel(mmx)
addition_2 = Addition(A=lng_2, B=1)
curvepoint = PointOnCurve(mmx, parameter=0.5)
trim_4 = TrimTree(Tree=addition_2, Depth=1)
lng_3 = ListLength(List=trim_4)
series_3 = Series(Start=0, Step=1, Count=lng_3)  # -> simplify(Series)
debox = DeconstructBox(Box=bbox.Box)  # -> Plane, X, Y, Z
pdecon = Deconstruct(Point=curvepoint)  # -> XComponent, YComponent, ZComponent
trim_5 = TrimTree(Tree=lng_2, Depth=1)
equals = Equality(FirstNumber=trim_5, SecondNumber="1")  # -> Equality, Inequality
inc = Includes(Value=flatten(pdecon.XComponent), Domain=graft(debox.X))  # -> simplify(Includes), Deviation
inc_2 = Includes(Value=flatten(pdecon.YComponent), Domain=graft(debox.Y))  # -> simplify(Includes), Deviation
trim_6 = TrimTree(Tree=curvepoint, Depth=1)
and = GateAnd(A=inc.Includes, B=inc_2.Includes)
lng_4 = ListLength(List=debox.X)
trim_7 = TrimTree(Tree=division_7, Depth=1)
cull = CullPattern(List=series_3, CullPattern=equals.Equality)
cull_2 = CullPattern(List=trim_7, CullPattern=equals.Equality)  # -> flatten(List)
lng_5 = ListLength(List=cull_2)
multiplication_6 = Multiplication(A=lng_5, B=lng_4)
repeat_5 = RepeatData(Data=cull_2, Length=multiplication_6)
partition_7 = PartitionList(List=repeat_5, Size=lng_5)  # -> simplify(Chunks)
dispatch_3 = Dispatch(List=partition_7, DispatchPattern=and)  # -> ListA, ListB

# ---- group: DISPLAY LINES
panel_16 = Panel("2")
trim_8 = TrimTree(Tree=mmx, Depth=1)
trim_9 = TrimTree(Tree=division_7, Depth=1)
lng_6 = ListLength(List=mmx)
group = Group(Objects=trim_8)  # -> flatten(Group)
equals_2 = Equality(FirstNumber=lng_6, SecondNumber="1")  # -> Equality, Inequality
trim_10 = TrimTree(Tree=equals_2.Equality, Depth=1)
series_4 = Series(Start=0, Step=1, Count=10)
item_7 = ListItem(List=group, Index=number_slider_12, Wrap=True)
ungroup = Ungroup(Group=item_7)
cull_3 = CullPattern(List=series_3, CullPattern=trim_10)
len_5 = Length(Curve=ungroup)
item_8 = ListItem(List=trim_9, Index=cull_3, Wrap=True)
pt_4 = ConstructPoint(XCoordinate=0, YCoordinate=0, ZCoordinate=item_8)
group_2 = Group(Objects=pt_4)  # -> flatten(Group)
panel_17 = Panel(len_5)
item_9 = ListItem(List=group_2, Index=number_slider_12, Wrap=True)
smaller = SmallerThan(FirstNumber=len_5, SecondNumber=number_slider_12)  # -> SmallerThan, OrEqualTo
ungroup_2 = Ungroup(Group=item_9)
pdecon_2 = Deconstruct(Point=ungroup_2)  # -> XComponent, YComponent, ZComponent
dispatch_4 = Dispatch(List=len_5, DispatchPattern=smaller.OrEqualTo)  # -> ListA, ListB
division_8 = Division(A=dispatch_4.ListA, B=dispatch_4.ListA)
multiplication_7 = Multiplication(A=number_slider_12, B=division_8)
weave_3 = Weave(Pattern=smaller.OrEqualTo, Stream0=dispatch_4.ListB, Stream1=multiplication_7, NullGaps=False)
division_9 = Division(A=pdecon_2.ZComponent, B=weave_3)
gradient = Gradient(LowerLimit=0, UpperLimit="2.5", Parameter=division_9, stops=[0.00476: RGB(0, 0, 0), 1: RGB(255, 255, 255)])

# ----
preview = CustomPreview(Geometry=ungroup, Material=gradient)

# ---- group: DECIBEL ADDITION (ABSTRACT)
clean = CleanTree(RemoveNulls=True, RemoveInvalid=True, RemoveEmpty=True, Tree=dispatch_3.ListA)
lng_7 = ListLength(List=flatten(clean))
button = Button()
panel_18 = Panel(clean)
panel_19 = Panel(lng_7)
flip = FlipMatrix(Data=clean)
ma_4 = MassAddition(Input=flip)  # -> Result, PartialResults
division_10 = Division(A=ma_4.Result, B=Slider(19, range=0..100))
flip_2 = FlipMatrix(Data=division_10)
flatten = FlattenTree(Tree=flip_2, Path="{0}")
panel_20 = Panel(flatten)
ma_5 = MassAddition(Input=flatten)  # -> Result, PartialResults
lng_8 = ListLength(List=ma_5.PartialResults)
series_5 = Series(Start=0, Step=Slider(5, range=0..10), Count=lng_8)
pt_5 = ConstructPoint(XCoordinate=series_5, YCoordinate=ma_5.PartialResults, ZCoordinate=0)
pline = PolyLine(Vertices=pt_5, Closed=False)
panel_21 = Panel(".1")
lng_9 = ListLength(List=subsrf)
series_6 = Series(Start=0, Step=1, Count=lng_9)

# ---- group: DECIBEL ADDITION (ABSTRACT) / Flat @ 0.6
number_slider_16 = Slider(1, range=0..1)
sort = SortList(Keys=clean)  # -> Keys, ValuesA
data_11 = Data(sort.Keys)
sort_2 = SortList(Keys=data_11)  # -> reverse(Keys), ValuesA
lng_10 = ListLength(List=sort_2.Keys)
subtraction_2 = Subtraction(A=lng_10, B=number_slider_16)
repeat_6 = RepeatData(Data=number_slider_16, Length=subtraction_2)  # -> simplify(Data)
repeat_7 = RepeatData(Data=Slider(0, range=0..100), Length=subtraction_2)  # -> simplify(Data)
item_10 = ListItem(List=repeat_6, Index=0, Wrap=True)
merge_3 = Merge(Data1=item_10, Data2=repeat_7)
dispatch_5 = Dispatch(List=sort_2.Keys, DispatchPattern=merge_3)  # -> simplify(ListA), simplify(ListB)
sort_3 = SortList(Keys=dispatch_5.ListB)  # -> reverse(Keys), ValuesA
panel_22 = Panel("""0.0
0.5
1.0
1.5
2.0
2.5
3.0
3.5
4.0
4.5
5.0
5.5
6.0
6.5
7.0
7.5
8.0
8.5
9.0
9.5
10
14
18
24""")
panel_23 = Panel("""3.0
2.8
2.5
2.3
2.1
1.9
1.7
1.6
1.4
1.3
1.2
1.1
1.0
0.9
0.8
0.7
0.7
0.6
0.6
0.5
0.4
0.2
0.1
.001""")
number_slider_17 = Slider(1000, range=0..1000)
pt_6 = ConstructPoint(XCoordinate=panel_22, YCoordinate=panel_23, ZCoordinate=0)
pline_2 = PolyLine(Vertices=pt_6, Closed=False)
pt_7 = ConstructPoint(XCoordinate=Slider(100, range=0..100), YCoordinate=0, ZCoordinate=0)
reb_2 = RebuildCurve(Curve=pline_2, Degree=Slider(3, range=0..10), Count=Slider(5, range=0..10), Tangents=False)
end = EndPoints(Curve=reb_2)  # -> Start, End
ln = Line(StartPoint=end.End, EndPoint=pt_7)
join_2 = JoinCurves(Curves=[reb_2, ln], Preserve=False)

# ---- group: DECIBEL ADDITION (ABSTRACT) (continued)
panel_24 = Panel(sort_3.Keys)
addition_3 = Addition(A=dispatch_5.ListA, B=0.1)
lng_11 = ListLength(List=subtraction_2)  # -> flatten(Length)
lng_12 = ListLength(List=dispatch_5.ListB)  # -> flatten(Length)
sort_4 = SortList(Keys=lng_12)  # -> Keys, ValuesA
sort_5 = SortList(Keys=lng_11)  # -> Keys, ValuesA
item_11 = ListItem(List=merge_3, Index=0, Wrap=True)
simplify = SimplifyTree(Tree=item_11, Front=False)
branch = TreeBranch(Tree=simplify, Path=series_6, MaintainPaths=True)
lng_13 = ListLength(List=branch)
equals_3 = Equality(FirstNumber=lng_13, SecondNumber="1")  # -> Equality, Inequality

# ---- group: DECIBEL ADDITION (ABSTRACT) / Flat @ 0.6 (continued)
python_3 = PythonScript(StartingValue=addition_3, TestValues=sort_3.Keys, GraphCurve=join_2)  # -> simplify(out), a; inputs TestValues: list, GraphCurve: Curve
# ---------- python_3: Python ----------
#start with the starting value
#subtract the first item of the test value
#you now have the difference between the two
#plot this on the graph to find its Y coodinate
#add that value to the starting value
#repeat step 2 using the new value as the start

import rhinoscriptsyntax as rs

val = StartingValue
pointlist = []

for i in TestValues:
    Diff = val - i
    newPoint = rs.AddPoint(Diff,-1,0)
    farPoint = rs.AddPoint(Diff,4,0)
    newLine = rs.AddLine(newPoint,farPoint)
    intersect = rs.CurveCurveIntersection(newLine, GraphCurve)
    if intersect:
        point1 = intersect[0]
    else:
        point1 = [0,0,0]
    elements = str(point1).split("[")
    firstElement = elements[1]
    elementNew = firstElement.split("]")
    numberSplit = elementNew[0].split(",")
    YVal = numberSplit[1]
    val = val+float(YVal)
print(val)
a = val
# ---------- end python_3 ----------
ma_6 = MassAddition(Input=python_3.out)  # -> flatten(Result), PartialResults
ma_7 = MassAddition(Input=ma_6.Result)  # -> flatten(Result), PartialResults
division_11 = Division(A=ma_7.Result, B=Slider(19, range=0..100))
panel_25 = Panel(division_11)

# ---- group: DECIBEL ADDITION (ABSTRACT) (continued)
panel_26 = Panel(python_3.out)
flatten_2 = FlattenTree(Tree=python_3.out, Path="{0}")
sort_6 = SortList(Keys=flatten_2)  # -> Keys, ValuesA
panel_27 = Panel(sort_6.Keys)
flatten_3 = FlattenTree(Tree=python_3.out, Path="{0}")
lng_14 = ListLength(List=flatten_3)
subtraction_3 = Subtraction(A=lng_9, B=lng_14)
simplify_2 = SimplifyTree(Tree=python_3.out, Front=False)
repeat_8 = RepeatData(Data="0", Length=subtraction_3)
weave_4 = Weave(Pattern=flatten(equals_3.Inequality), Stream0=flatten(simplify_2), Stream1=flatten(repeat_8), NullGaps=False)

# ---- group: DISPLAY CONTOURS
Z = UnitZ(Factor=weave_4)
move_2 = Move(Geometry=area.Centroid, Motion=Z)  # -> Geometry, Transform
srfgrid = SurfaceFromPoints(Points=move_2.Geometry, UCount=division_4, Interpolate=False)
contour = Contour(Shape=srfgrid, Point=Point(0, 0, 0), Direction=Vector(0, 0, 1), Distance=Slider(0.5, range=0..1))
item_12 = ListItem(List=contour, Index=0, Wrap=True)
project = Project(Geometry=contour, Plane=xy)  # -> Geometry, Transform
end_2 = EndPoints(Curve=item_12)  # -> Start, End
pdecon_3 = Deconstruct(Point=end_2.Start)  # -> XComponent, YComponent, ZComponent
group_3 = Group(Objects=project.Geometry)
flatten_4 = FlattenTree(Tree=pdecon_3.ZComponent, Path="{0}")
bnd = Bounds(Numbers=flatten_4)
dedomain = DeconstructDomain(Domain=bnd)  # -> Start, End
gradient_2 = Gradient(
    LowerLimit=Slider(100, range=0..100),
    UpperLimit=dedomain.End,
    Parameter=pdecon_3.ZComponent,
    stops=[0: RGB(5, 1, 0), 0.115: RGB(0, 0, 0), 0.2: RGB(0, 0, 0), 0.3: RGB(103, 0, 120), 0.4: RGB(39, 72, 161), 0.5: RGB(1, 192, 229), 0.6: RGB(18, 178, 90), 0.7: RGB(79, 186, 8), 0.8: RGB(220, 237, 32), 0.9: RGB(247, 159, 20), 1: RGB(243, 57, 0)])

# ----
preview_2 = CustomPreview(Geometry=group_3, Material=gradient_2)
